# Grasshopper definition sample_grasshopper_script.gh (Grasshopper 1.0.7)
# plug-ins: UrbanGenerator

path = FilePath("C:\Users\Eppy\Documents\MyCode\UrbanGeneratorModels\")
ug = UrbanGenerator(ModelDirectory=path)  # -> Footprint, FirstFloors, Walls, Windows, Overhangs, Roofs, Debug
panel = Panel(ug.Debug)
item = ListItem(List=ug.Windows, Index=Slider(8, range=0..10), Wrap=True)
preview = CustomPreview(Geometry=ug.FirstFloors, Material=ColourSwatch(SwatchColor=RGB(153, 153, 153)))
preview_2 = CustomPreview(Geometry=ug.Walls, Material=ColourSwatch(SwatchColor=RGB(255, 255, 255)))
preview_3 = CustomPreview(Geometry=ug.Windows, Material=ColourSwatch(SwatchColor=RGB(44, 166, 222)))
preview_4 = CustomPreview(Geometry=ug.Overhangs, Material=ColourSwatch(SwatchColor=RGB(74, 148, 110)))
preview_5 = CustomPreview(Geometry=ug.Roofs, Material=ColourSwatch(SwatchColor=RGB(48, 48, 48)))
